# Dynamo graph AI constructor test - load.dyn (Dynamo 1.3.0.875)

# group: Inputs
file_path = Filename(".\AI IO test -NaiveBayesMachine (trained).json")
code_block = CodeBlock { name="Simple Linear Regression"; file="AI IO test - "+name+".json"; }

# group: IO
directoryName = FilePath.DirectoryName(file_path)
combine = FilePath.Combine(directoryName, code_block.file)

# group: Deserialise
load = AI.Machine.Load(combine)

# group: Deserialise only if the file exists
exists = File.Exists(combine)
code_block_2 = CodeBlock { null; }
if_ = If(test=exists, true=load, false=code_block_2)

# group: Inspect
name = AI.Machine.Name(if_)
description = AI.Machine.Description(if_)
GUID = AI.Machine.GUID(if_)
getAlgorithm = AI.Machine.GetAlgorithm(if_)
isTrained = AI.Machine.IsTrained(if_)
result = AI.Machine.Result(if_)
