# Dynamo graph AI constructor test NaiveBayes - save.dyn (Dynamo 2.0.2.6826)

# group: Inputs
training_data = CodeBlock()
# ---------- training_data.designscript (16 lines) ----------
[
[ "Sunny", "Hot", "High", "Weak", "No" ],
[ "Sunny", "Hot", "High", "Strong", "No" ],
[ "Overcast", "Hot", "High", "Weak", "Yes" ],
[ "Rain", "Mild", "High", "Weak", "Yes" ],
[ "Rain", "Cool", "Normal", "Weak", "Yes" ],
[ "Rain", "Cool", "Normal", "Strong", "No" ],
[ "Overcast", "Cool", "Normal", "Strong", "Yes" ],
[ "Sunny", "Mild", "High", "Weak", "No" ],
[ "Sunny", "Cool", "Normal", "Weak", "Yes" ],
[  "Rain", "Mild", "Normal", "Weak", "Yes" ],
[  "Sunny", "Mild", "Normal", "Strong", "Yes" ],
[  "Overcast", "Mild", "High", "Strong", "Yes" ],
[  "Overcast", "Hot", "Normal", "Weak", "Yes" ],
[  "Rain", "Mild", "High", "Strong", "No" ]
];
# ----------------------------------------
# note: In this exercise, we will be using the famous Play Tennis example by Tom Mitchell (1998). In Mitchell's example, one would like to infer if a person would play tennis or not based solely on four input variables :
# - Outlook
# - Temperature
# - Humidity
# - Wind
# The rows of data presented below represent days on which the behavior of the person has been registered, pretty much building our set of observation instances for learning.
code_block = CodeBlock { [ "Outlook", "Temperature", "Humidity", "Wind", "PlayTennis" ]; }
code_block_2 = CodeBlock { "PlayTennis"; }
code_block_3 = CodeBlock { name="NaiveBayesMachine"; desc="simple machine"; file="AI IO test -"+name+".json"; }
file_path = Filename(".\AI constructor test.json")  # graph input

naiveBayesClassifier = AI.Algorithms.Classifier.NaiveBayesClassifier.NaiveBayesClassifier(inputMatrix=training_data, columnList=code_block, outputColumn=code_block_2)
code_block_4 = CodeBlock { ""; }
machine = AI.Machine.Machine(algorithm=naiveBayesClassifier, name=code_block_4, description=code_block_4)

# group: Inspect
getAlgorithm = AI.Machine.GetAlgorithm(machine=machine)
GUID = AI.Machine.GUID(machine=machine)
name = AI.Machine.Name(machine=machine)

# group: IO
code_block_5 = CodeBlock(machine=machine, filepath=code_block_3.file) { machine; filepath; }
directoryName = FileSystem.DirectoryName(path=file_path)
combinePath = FileSystem.CombinePath(path0=directoryName, path1=code_block_5.filepath)
save = AI.Machine.Save(machine=code_block_5.machine, filePath=combinePath)
