# Dynamo graph AI learn test - Multiple Linear Regression.dyn (Dynamo 1.3.0.875)

# group: Inputs
code_block = CodeBlock()
# ---------- code_block.designscript (5 lines) ----------
{
{  1,  1,  1 },
{  2,  1,  1 },
{  3,  1,  1 }
};
# ----------------------------------------
code_block_2 = CodeBlock { {  2.0,  3.0 }; }
code_block_3 = CodeBlock { name="NaiveBayesMachine"; desc="simple machine"; file="AI IO test -"+name+" (trained).json"; }

# group: Build machine
multipleLinearRegression = AI.Algorithms.Regression.MultipleLinearRegression.MultipleLinearRegression(code_block, code_block_2)
machine = AI.Machine.Machine(multipleLinearRegression, code_block_3.name, code_block_3.desc)

# group: Learn
learn = AI.Machine.Learn(machine)

# group: The input value to test
validation_line = CodeBlock()
# ---------- validation_line.designscript (4 lines) ----------
{
{  1.5,  2.0,  1.0 },
{  3.0,  1.0,  1.0 }
};
# ----------------------------------------

# group: Predict
getAlgorithm = AI.Machine.GetAlgorithm(learn)
# note: Use the Predictor on the algorithm due to a bug in Dynamo's handling of data types.
# to be fixed later.
predict = AI.Algorithms.Regression.MultipleLinearRegression.Predict(getAlgorithm, validation_line)
