# Dynamo graph AI learn test - Simple Linear Regression.dyn (Dynamo 1.3.0.875)

# group: Training Data
input_values = CodeBlock()
# ---------- input_values.designscript (10 lines) ----------
{500,
3500,
4400,
4700,
5400,
3700,
6200,
5200,
6600,
6600};
# ----------------------------------------
corresponding_output_values = CodeBlock()
# ---------- corresponding_output_values.designscript (10 lines) ----------
{1000000,
1600000,
2200000,
2500000,
3100000,
3300000,
3500000,
2600000,
3000000,
4000000};
# ----------------------------------------

# group: Constructor
simpleLinearRegression = AI.MachineLearning.Regression.SimpleLinearRegression.SimpleLinearRegression(input_values, corresponding_output_values)
code_block = CodeBlock { "TestMachine #1"; "simple machine"; }
machine = AI.Machine.Machine.Machine(simpleLinearRegression, code_block.out0, code_block.out1)

# group: Inspect
name = AI.Machine.Machine.Name(machine)
GUID = AI.Machine.Machine.GUID(machine)
getAlgorithm = AI.Machine.Machine.GetAlgorithm(machine)
hasTrainingDataLoaded = AI.MachineLearning.Regression.SimpleLinearRegression.HasTrainingDataLoaded(getAlgorithm)

# group: Predict new values
# note: Our machine has never before seen this particular value as input, so it will have to predict what the corresponding output value is.
# This is essentially what all the learning is about, being able to handle new scenarios.
code_block_2 = CodeBlock { 4506; }
predict = AI.Machine.Machine.Predict(machine, code_block_2)

learn = AI.Machine.Machine.Learn(machine)
